% Simulink data dictionary DesignDictionary.sldd

Logic = Simulink.ValueType(DataType="double", be=Simulink.BusElement(Name="a", DataType="double"))

DCBus = Simulink.ConnectionBus()
  Pos: Connection: foundation.electrical.electrical
  Neg: Connection: foundation.electrical.electrical

ACBus = Simulink.ConnectionBus()
  F1: Connection: <domain name>
  F2: Connection: <domain name>

PhysicalQuantity = Simulink.ValueType(DataType="double", be=Simulink.BusElement(Name="a", DataType="double"))